# Dynamo graph BIMTypeCode - Shared Parameters Swap - 2022.dyn "SharedParameterSwap" (Dynamo 2.12.0.5650)

code_block = CodeBlock()
# ---------- code_block.designscript (10 lines) ----------
ElementQueries.OfElementType(
	DSCore.Types.FindTypeByNameInAssembly(
		"SharedParameterElement","RevitAPI"));

["8d5d6d46-5941-4a67-a6ab-68458526bfb0",
"fbaedb8d-12e1-438b-bb1d-9b95c1ce0213",
"d6b7c152-dcbc-4c0d-b410-b8c8d5cead34",
"90152c58-6c18-44d4-9b86-cc99443abe2c",
"c31ffab0-b425-400a-957f-fda842767c9a",
"215801fe-1104-46c3-a5f5-15c738582799"];
# ----------------------------------------
python_script = Python(IN[0]=code_block.out0)  # IronPython2
# ---------- python_script.python (2 lines) ----------
# Assign your output to the OUT variable.
OUT = [UnwrapElement(x).GuidValue for x in IN[0]]
# ----------------------------------------
code_block_2 = CodeBlock(guidToStr=python_script) { guidToStr+""; }
allIndicesOf = List.AllIndicesOf(list=code_block_2, item=code_block.out1)
flatten = List.Flatten(list=allIndicesOf)
getItemAtIndex = List.GetItemAtIndex(list=code_block.out0, index=flatten)
code_block_3 = CodeBlock(sp=getItemAtIndex) { sp.Name; }
the_following_paramteres_were = Watch(code_block_3)  # "The following paramteres were deleted:"; graph output
code_block_4 = CodeBlock { Category.ByName("Generic Models"); "PG_TEXT"; false; }
filsti_til_sharedparameter_fil = Filename("No file selected.")  # graph input
delete = Element.Delete(element=getItemAtIndex)
code_block_5 = CodeBlock(pass=filsti_til_sharedparameter_fil, wait=delete) { [pass,wait][0]; }
python_script_2 = Python(IN[0]=code_block_5)  # IronPython2
# ---------- python_script_2.python (33 lines) ----------
#Copyright (c) mostafa el ayoubi
#Data-Shapes www.data-shapes.net 2016 elayoub.mostafa@gmail.com


import clr
clr.AddReference('RevitAPI')
from Autodesk.Revit.DB import*
clr.AddReference('RevitServices')
from RevitServices.Persistence import DocumentManager
from RevitServices.Transactions import TransactionManager
clr.AddReference('RevitAPIUI')
from Autodesk.Revit.UI import *


doc = DocumentManager.Instance.CurrentDBDocument
uidoc = DocumentManager.Instance.CurrentUIDocument
app = doc.Application

TransactionManager.Instance.EnsureInTransaction(doc)

app.SharedParametersFilename  =IN[0]
spfile = app.OpenSharedParameterFile()
gr = spfile.Groups
defp = [g.Definitions for g in gr]
defflat = [x for l in defp for x in l]
defflatname = [x.Name for x in defflat]


TransactionManager.Instance.TransactionTaskDone()



OUT = defflat , defflatname
# ----------------------------------------
code_block_6 = CodeBlock(x=python_script_2) { x[0]; x[1]; }
python_script_3 = Python(IN[0]=code_block_4.out0, IN[1]=code_block_6.out0, IN[2]=code_block_4.out1, IN[3]=code_block_4.out2)  # IronPython2
# ---------- python_script_3.python (67 lines) ----------
#Copyright (c) mostafa el ayoubi
#Data-Shapes www.data-shapes.net 2016 elayoub.mostafa@gmail.com


import clr
import System
clr.AddReference('RevitAPI')
from Autodesk.Revit.DB import*
clr.AddReference('RevitServices')
from RevitServices.Persistence import DocumentManager
from RevitServices.Transactions import TransactionManager
clr.AddReference('RevitAPIUI')
from Autodesk.Revit.UI import *
from Autodesk.Revit import Creation


doc = DocumentManager.Instance.CurrentDBDocument
uidoc = DocumentManager.Instance.CurrentUIDocument
app = doc.Application


if isinstance(IN[0], list):
	category = [i for i in IN[0]]
else:
	category= [IN[0]]
	
#getting list of categories
try:
	categories = [doc.Settings.Categories.get_Item(System.Enum.ToObject(BuiltInCategory, i.Id)) for i in category]
except:
	categories = [UnwrapElement(i) for i in category]
	
#creating category set
catset = app.Create.NewCategorySet()
[catset.Insert(j) for j in categories]

if isinstance(IN[1], list):
	parameters = [i for i in IN[1]]
else:
	parameters = [IN[1]]
	
try:
	group = [a for a in System.Enum.GetValues(BuiltInParameterGroup) if a == IN[2]][0]
except:
	group = [a for a in System.Enum.GetValues(BuiltInParameterGroup) if str(a) == IN[2]][0]
i = 0

TransactionManager.Instance.EnsureInTransaction(doc)

#Determining whether the parameters are type or instance
if IN[3]:
	bind = app.Create.NewInstanceBinding(catset)
else : 
	bind = app.Create.NewTypeBinding(catset)
#Adding the parameters to the project
bindmap = doc.ParameterBindings
for p in parameters:
	try:
		bindmap.Insert(p, bind, group)
		i += 1
	except:
		continue

TransactionManager.Instance.TransactionTaskDone()


OUT =  '%d shared parameters addes to project' %(i)
# ----------------------------------------
code_block_7 = CodeBlock { "SharedParameterElement"; }
code_block_8 = CodeBlock(wait=python_script_3, pass=code_block_7) { [wait,pass][1]; }
code_block_9 = CodeBlock(sp=code_block_8)
# ---------- code_block_9.designscript (10 lines) ----------
ElementQueries.OfElementType(
	DSCore.Types.FindTypeByNameInAssembly(
		sp,"RevitAPI"));

["8d5d6d46-5941-4a67-a6ab-68458526bfb0",
"fbaedb8d-12e1-438b-bb1d-9b95c1ce0213",
"d6b7c152-dcbc-4c0d-b410-b8c8d5cead34",
"90152c58-6c18-44d4-9b86-cc99443abe2c",
"c31ffab0-b425-400a-957f-fda842767c9a",
"215801fe-1104-46c3-a5f5-15c738582799"];
# ----------------------------------------
python_script_4 = Python(IN[0]=code_block_9.out0)  # IronPython2; same code as python_script
code_block_10 = CodeBlock(guidToStr=python_script_4) { guidToStr+""; }
allIndicesOf_2 = List.AllIndicesOf(list=code_block_10, item=code_block_9.out1)
flatten_2 = List.Flatten(list=allIndicesOf_2)
getItemAtIndex_2 = List.GetItemAtIndex(list=code_block_9.out0, index=flatten_2)
code_block_11 = CodeBlock(sp=getItemAtIndex_2) { sp.Name; }
the_following_paramteres_were_2 = Watch(code_block_11)  # "The following paramteres were added:"; graph output
